# Grasshopper definition Read_Images_And_Camera_01.gh (Grasshopper 0.9.76)

# ----
# Rhino Inputs: (PURPLE)
# These are inputs from the Rhino model such as curves and surfaces.
panel = Panel("Rhino Inputs")

# ----
# Visual Queues: (YELLOW)
# These are used to verify outputs from varioius components.
panel_2 = Panel("Visual Queues")

# ----
# Outputs / Bake: (GREEN)
# These are meant to indicate points of departure from the GH definition.
panel_3 = Panel("Outputs / Bake")

# ----
# Color Legend:
# Parameters: (RED)
# These are values that are important to the user.
panel_4 = Panel("Parameters")

# ----
# Notes: (CYAN)
# These are notes / comments within the GH definition.
panel_5 = Panel("Notes")

# ----
# create a view
# create a plane perp to view
# create material
# apply jpg to material
number_slider = Slider(6.303, range=0..100)
c_script = CSharpScript(
    proximity=number_slider,
    scale=Slider(0.51, range=0..1),
    Reference="C:\Users\Charlie\Documents\01_DLL's\JSON\Net40\Newtonsoft.Json.dll")  # -> out, A; inputs ViewData: String, proximity: Double, scale: Double
# ---------- c_script: C# ----------
    // ----this is used for testing----
    Point3d location = new Point3d(-100, -100, 0);              // camera location
    Vector3d direction = new Vector3d(10, 10, 0);               // camera direction
    Image img = System.Drawing.Image.FromFile(@"C:\Users\Charlie\Pictures\Small_Image_01.jpg"); // change this to a file on your drive
    // ----this is used for testing----
    
    Image img2;
    string imageLocation;
    string base64String;
    byte[] imageBytes;

    // convert image to string - this is used for testing
    using (MemoryStream m = new MemoryStream())
    {
      img.Save(m, img.RawFormat);
      imageBytes = m.ToArray();
      base64String = Convert.ToBase64String(imageBytes);
    }

    // convet string to image
    using (var ms = new MemoryStream(imageBytes))
    {
      img2 = Image.FromStream(ms);
      img2.Save(Path.GetTempPath() + "tempImage.jpg");
      imageLocation = Path.GetTempPath() + "tempImage.jpg";
      Print("Image location: " + imageLocation);
    }

    Rhino.Display.RhinoViewport vp = RhinoDocument.Views.ActiveView.ActiveViewport;   // get active viewport
    vp.SetCameraDirection(direction, false);                                          // set camera diretion
    vp.SetCameraLocation(location, false);                                            // set camera location
    vp.Name = "name";                                                                 // set viewport name

    Plane pln = new Plane(location, direction);                                       // create perp plane
    Transform trans = Transform.Translation(Vector3d.Multiply(direction, proximity));
    pln.Transform(trans);
    vp.SetConstructionPlane(pln);                                                     // set construction plane

    Brep rep = CreateRect(pln, img, scale);                                           // get rect brep

    // add material to object
    int MaterialIndex = RhinoDocument.Materials.Add();                                // add material to file
    Rhino.DocObjects.Material material = RhinoDocument.Materials[MaterialIndex];      // get new material
    Print("Material to texture: " + material.SetBitmapTexture(imageLocation).ToString());
    Print("Material is valid: " + material.IsValid.ToString());
    material.SetBumpTexture(imageLocation);                                           // set material texture
    material.Name = "MyMaterial";                                                     // set material name
    material.CommitChanges();
    ObjectAttributes attributes = new Rhino.DocObjects.ObjectAttributes();            // set object attributes
    attributes.MaterialIndex = MaterialIndex;                                         // set material index
    attributes.MaterialSource = ObjectMaterialSource.MaterialFromObject;              // set object material source
    RhinoDocument.Objects.AddBrep(rep, attributes);                                   // bake object

    /*Rhino.DocObjects.ViewportInfo viewPortInfo = new Rhino.DocObjects.ViewportInfo();
    viewPortInfo.SetCameraLocation(location);
    viewPortInfo.SetCameraDirection(direction);
    viewPortInfo.ChangeToPerspectiveProjection(Rhino.RhinoMath.UnsetValue, true, 50);
    */
# ---------- c_script: C# additional code ----------
  // Create a rect srf on a plane
  Brep CreateRect(Plane pln, Image img, double scale){

    double width = (img.Width) * scale;              // get image dimensions
    double height = (img.Height) * scale;

    Interval wInt = new Interval(-(width / 2.0), (width / 2.0));
    Interval hInt = new Interval(-(height / 2.0), (height / 2.0));

    Rectangle3d rect = new Rectangle3d(pln, wInt, hInt);
    Polyline poly = rect.ToPolyline();
    Curve[] crvs = {poly.SegmentAt(0).ToNurbsCurve(), poly.SegmentAt(1).ToNurbsCurve(),
      poly.SegmentAt(2).ToNurbsCurve(), poly.SegmentAt(3).ToNurbsCurve()};

    Brep rep = Brep.CreateEdgeSurface(crvs);
    return rep;
  }


  /*public class cls_CameraImage{

    public Point3d location;
    public Vector3d direction;
    public Image img;


    // deserialize json data
    public cls_CrameraImage(string JsonData){

    }
  }
*/
# ---------- end c_script ----------
panel_6 = Panel(c_script.out)
